# Dynamo graph Code Group node types.dyn (Dynamo 1.3.3.4651)

# note: group existing nodes into a container called "custom node".
# This is saved as a DYF file and can be easily shared, but is not contained within the DYN file.
this_is_a_custom_node = Custom[This is a custom node]()  # This is a custom node made with Dynamo; unwired: arg0
# note: This node accepts DesignScript, which is a full programming language like Python.
# Usually used for simple operations & scripts.
code_block = CodeBlock(x=this_is_a_custom_node)
# ---------- code_block.designscript (2 lines) ----------
x;
// This is a code block node
# ----------------------------------------
# note: This is a node containing python code, supports modules and packages. It is a very powerful and quick way to add custom functionalities, and you don’t need to compile your code
python_script = Python(IN[0]=code_block)  # starter script, not edited (OUT = 0)
# note: create or import custom code written in C#. It is a more complex choice but you will benefit of the .NET framework, a solid IDE, debugging tools and lots of libraries.
# Dynamo maps methods and classes to nodes automatically, so you have little to do on the C# side to make nodes.
byUrl = DynaWeb.WebRequest.ByUrl(python_script)
# note: basically a native Dynamo node written in C#, it implements the NodeModel interface, can have a custom UI and affect the state of the graph.
# This is the uber-advanced option, requiring functionality in separate assemblies, messing with WPF UI etc.
speckle_receiver = Receiver(byUrl)
code_block_2 = CodeBlock { ThisIsEasy=0; }
code_block_3 = CodeBlock(ThisIsHard=code_block_2) { ThisIsHard; }
