# Dynamo graph Custom nodes types.dyn (Dynamo 2.0.1.5055)

code_block = CodeBlock { ThisIsEasy=0; }
code_block_2 = CodeBlock(ThisIsHard=code_block) { ThisIsHard; }
# note: group existing nodes into a container called "custom node".
# This is saved as a DYF file and can be easily shared, but is not contained within the DYN file.
this_is_a_custom_node = Custom[This is a custom node]()  # unwired: arg0
# note: This node accepts DesignScript, which is a full programming language like Python.
# Usually used for simple operations & scripts.
code_block_3 = CodeBlock(x=this_is_a_custom_node)
# ---------- code_block_3.designscript (3 lines) ----------
x;
y="Dynamo code";
// This is a code block node
# ----------------------------------------
# note: This is a node containing python code, supports modules and packages. It is a very powerful and quick way to add custom functionalities, and you don’t need to compile your code
python_script = Python(IN[0]=code_block_3.y)
# ---------- python_script.python (8 lines) ----------
import clr
clr.AddReference('ProtoGeometry')
from Autodesk.DesignScript.Geometry import *
#The inputs to this node will be stored as a list in the IN variables.
dataEnteringNode = IN

#Assign your output to the OUT variable.
OUT = IN[0]
# ----------------------------------------
# note: create or import custom code written in C#. It is a more complex choice but you will benefit of the .NET framework, a solid IDE, debugging tools and lots of libraries.
# Dynamo maps methods and classes to nodes automatically, so you have little to do on the C# side to make nodes.
sayHello = DynamoWorkshop.ZeroTouch.HelloDynamo.SayHello(Name=python_script)
# note: basically a native Dynamo node written in C#, it implements the NodeModel interface, can have a custom UI and affect the state of the graph.
# This is the uber-advanced option, requiring functionality in separate assemblies, messing with WPF UI etc.
speckle_receiver = Receiver(ID=sayHello, DocumentName="Code Group node types 2", OldStreamId="Hello Dynamo code!", myReceiver="dZA9T8MwEIadkqQRMDEwdXDFGiV0RcpAw0DVBfWDtTLJSbVytSN/FPW3M1Af6dCFs3xn+Z57zz4WMcZ+g1Ekux8FN1/30HQItTaQ808wVmpVzYpnWjmvPTpvoFLgnRGY8w//hbJZwmmjO1CV8ogJCU6udIrL+bWXNUpQLgnAeC4sbA1ma2dAHBZtvNIIWWD+lLKBXLRRFEejx2u1IUM0PZh2ehPc09653r6U5R6sk6KwQ0nxrU1nS9HL8jhL4wA+vAOi5m8nJQ6aN7qFafIT5vBPE/rN+CjQw27HMmpHN2lKI7u9OwM=", RestApi="https://hestia.speckle.works/api/v1", Email="georgios@grimshaw.global", Server="Speckle Hestia", StreamId="Hello Dynamo code!", Transmitting=true, Paused=false, StreamTextBoxEnabled=false)
