# Dynamo graph 1-IO-Exceptions.dyn (Dynamo 2.0.1.5055)

# group: ThrowExceptionIfStringIsNull
string = StringInput("")
throwExceptionIfStringIsNull = DynamoWorkshop.ZeroTouch.Exceptions.ThrowExceptionIfStringIsNull(text=string)
watch = Watch(throwExceptionIfStringIsNull)

# group: HandleListNullExceptionsInternally
code_block = CodeBlock()
# ---------- code_block.designscript (10 lines) ----------
[
1,
2,
3,
null,
0,
3,
null,
1
];
# ----------------------------------------
handleListNullExceptionsInternally = DynamoWorkshop.ZeroTouch.Exceptions.HandleListNullExceptionsInternally(list=code_block)
watch_2 = Watch(handleListNullExceptionsInternally)

# group: Dynamo built-in sum
sum = Math.Sum(values=code_block)
code_block_2 = CodeBlock()
# ---------- code_block_2.designscript (8 lines) ----------
[
1,
2,
3,
0,
3,
1
];
# ----------------------------------------
sum_2 = Math.Sum(values=code_block_2)
