# Dynamo graph 1-IO-Geometry.dyn (Dynamo 2.0.1.5055)

# group: Deconstruct Point
code_block = CodeBlock { 10; 15; 25; }
byCoordinates = Point.ByCoordinates(x=code_block.out0, y=code_block.out1, z=code_block.out2)
deconstructPoint = DynamoWorkshop.ZeroTouch.Geometry.DeconstructPoint(point=byCoordinates)
watch = Watch(deconstructPoint.X)
watch_2 = Watch(deconstructPoint.Y)
watch_3 = Watch(deconstructPoint.Z)

# group: LineByCoordinatesPair
code_block_2 = CodeBlock { 5; 20; }
lineByCoordinatesPair = DynamoWorkshop.ZeroTouch.Geometry.LineByCoordinatesPair(X1=code_block_2.out0, Y1=code_block_2.out0, Z1=code_block_2.out0, X2=code_block_2.out1, Y2=code_block_2.out1, Z2=code_block_2.out1)
watch_4 = Watch(lineByCoordinatesPair)
