# Dynamo graph 1-IO-Mapping.dyn (Dynamo 2.0.1.5055)

# group: Instance constructor
string = StringInput("AEC Hackathon")
byUserTextConstructor = DynamoWorkshop.ZeroTouch.ExampleZeroTouchClass.ByUserTextConstructor(text=string)
zeroTouchPublicProperty = DynamoWorkshop.ZeroTouch.ExampleZeroTouchClass.ZeroTouchPublicProperty(exampleZeroTouchClass=byUserTextConstructor)
watch = Watch(zeroTouchPublicProperty)

# group: Static methods
getRandomNumberFromAStaticMethod = DynamoWorkshop.ZeroTouch.ExampleZeroTouchClass.GetRandomNumberFromAStaticMethod()
watch_2 = Watch(getRandomNumberFromAStaticMethod)

# group: Instance method
string_2 = StringInput("Updated Hackathon")
updatePublicPropertyAction = DynamoWorkshop.ZeroTouch.ExampleZeroTouchClass.UpdatePublicPropertyAction(exampleZeroTouchClass=byUserTextConstructor, text=string_2)

zeroTouchPublicProperty_2 = DynamoWorkshop.ZeroTouch.ExampleZeroTouchClass.ZeroTouchPublicProperty(exampleZeroTouchClass=updatePublicPropertyAction)

# group (continued): Instance method
watch_3 = Watch(zeroTouchPublicProperty_2)
