# Dynamo graph 1-IO-Revit.dyn (Dynamo 2.0.1.5055)

code_block = CodeBlock { "Hello AEC Hackathon"; }
code_block_2 = CodeBlock { 2; }
levels = Levels(index=0)
wall_types = WallTypes(index=11)
code_block_3 = CodeBlock { 10; }
sayHello = DynamoWorkshop.ZeroTouch.HelloRevit.SayHello(text=code_block, height=code_block_2, level=levels, wallType=wall_types, size=code_block_3)
