# Dynamo graph 2-ExplicitNode-Function.dyn (Dynamo 2.0.1.5055)

# group: HelloUI Multiplication
number_slider = DoubleSlider(6.8, range=0..10 step 0.1)
helloUI = HelloUI(A=number_slider, SliderValue=4)
watch = Watch(helloUI)
